# Grasshopper definition 170713_softBodyDemo.gh (Grasshopper 0.9.76)
# plug-ins: FlexHopper

mesh = Mesh(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)
vec = VectorXYZ(XComponent=15, YComponent=0, ZComponent=0)  # -> Vector, Length
Z = UnitZ(Factor=100)
xy = XYPlane(Origin=Point(0, 0, 0))
panel = Panel("""1
2
0
1.5
2
0.1
1.5
0.0
0.0""")
move = Move(Geometry=mesh, Motion=vec.Vector)  # -> Geometry, Transform
collgeometry = FlexCollisionGeometry(CollisionPlanes=flatten(xy))
soft = SoftFromMesh(SoftBodyMesh=move.Geometry, Velocities=Vector(0, 0, 0), Mass=1, SoftParams=panel, GroupIndex=0)
scene = FlexScene(SoftBodies=flatten(soft))
panel_2 = Panel(scene)
flex = FlexEngine(FlexCollisionGeometry=collgeometry, FlexScene=flatten(scene), LockMode=False, Reset=Button(), Go=Toggle(False))  # -> FlexObject, Information
panel_3 = Panel(flex.Information)
allsprings = GetAllSprings(FlexObject=flex.FlexObject, N=1)
allparts = GetAllParticles(FlexObject=flex.FlexObject, N=1)  # -> Points, Vector
